# Dynamo graph AI 规范助手.dyn (Dynamo 2.19.3.6394)
# packages: ArchAI 1.0.0

读取api_key = Python()  # CPython3
# ---------- 读取api_key.python (81 lines) ----------
import sys
import os
import json
import traceback

# 必须和Packages下的包文件夹名完全一致（大小写敏感）
PACKAGE_NAME = "ArchAI"
OUT = ""  # 初始化OUT，避免未定义

# ===================== 1. 自动定位节点包的根路径 =====================
# 获取APPDATA路径
appdata = os.environ.get("APPDATA")
# 定位Dynamo Revit根目录
dynamo_root = os.path.join(appdata, "Dynamo", "Dynamo Revit")
if not os.path.isdir(dynamo_root):
    print(f"Dynamo根目录不存在 - {dynamo_root}")
# 遍历版本目录，查找包路径
lib_path = None
try:
    for version_dir in os.listdir(dynamo_root):
        version_path = os.path.join(dynamo_root, version_dir)
        # 跳过非目录
        if not os.path.isdir(version_path):
            continue
        temp_lib = os.path.join(version_path, "Packages", PACKAGE_NAME)
        # 找到第一个有效路径就停止
        if os.path.exists(temp_lib):
            lib_path = temp_lib
            break
except OSError as e:
    print(f"遍历目录时出错：{str(e)}")

def get_package_lib_path():
    if lib_path not in sys.path:
        sys.path.append(lib_path)
    return lib_path, f"lib路径：{lib_path}" if lib_path else "未找到包的节点包目录"

# 初始化路径
get_package_lib_path()



# ===================== 读取API Key核心逻辑 =====================
# 1. 拼接文件夹 + 密钥文件路径（固定文件名为 api_key.txt，可自行修改）
lib_path, path_msg = get_package_lib_path()

# 你的原有逻辑：获取库路径
lib_path, path_msg = get_package_lib_path()

# ===================== 读取API Key核心逻辑 =====================
# 1. 拼接文件夹 + 密钥文件路径（固定文件名为 api_key.txt，可自行修改）
api_key_folder = os.path.join(lib_path, "ArchAI_Samples")
api_key_file = os.path.join(api_key_folder, "api_key.txt")

# 初始化api_key变量
api_key = None

try:
    # 2. 自动创建文件夹（不存在则创建，防止报错）
    if not os.path.exists(api_key_folder):
        os.makedirs(api_key_folder)
        print(f"已创建文件夹：{api_key_folder}")

    # 3. 读取txt文件中的API Key（自动去除空格/换行符）
    with open(api_key_file, "r", encoding="utf-8") as f:
        api_key = f.read().strip()  # strip() 清除首尾空白、换行
        OUT = api_key

    # 4. 校验密钥是否为空
    if not api_key:
        print(f"错误：{api_key_file} 文件内容为空，请填写API Key")
    else:
        print(f"成功读取API Key：{api_key[:4]}****")  # 脱敏打印，安全

# 捕获所有异常（文件不存在、权限不足、读取失败等）
except Exception as e:
    error_info = traceback.format_exc()
    print(f"读取API Key失败：{str(e)}")
    print(f"详细错误：{error_info}")
    print(f"请检查文件是否存在：{api_key_file}")
    
# ----------------------------------------
你的问题 = StringInput("")  # graph input
指定规范 = Filename("C:\Users\14020\AppData\Roaming\Dynamo\Dynamo Revit\2.19\packages\ArchAI\specification\assets\spec_files\核电厂防火设计规范_GBT22158-2021.md")  # graph input
fileName = FileSystem.FileName(path=指定规范)
specQuery = Custom[SpecQuery](api_key=读取api_key, user_query=你的问题, spec_name=fileName)  # package ArchAI; Leverage local custom spec library to constrain AI for precise, specification-compliant outputs | 依托本地自定义规范知识库，约束 AI 输出精准合规的专业结果
答复 = Watch(specQuery)  # graph output
