# Dynamo custom node AIChat.dyf (Dynamo 2.19.3.6394)
# category: ArchAI.Common
# Lightweight AI Q&A node for real-time natural language consultation | 轻量 AI 智能问答节点，支持自然语言即时对话答疑

api_key = Input(api_key: string)  # API Keys, Default to DeepSeek API 密钥，默认为 DeepSeek 模型
user_query = Input(user_query: string)  # Query Prompt 查询指令
python_script = Python(IN[0]=api_key, IN[1]=user_query)  # CPython3
# ---------- python_script.python (134 lines) ----------
import sys
import os
import json

# 必须和Packages下的包文件夹名完全一致（大小写敏感）
PACKAGE_NAME = "ArchAI"
OUT = ""  # 初始化OUT，避免未定义

# ===================== 1. 自动定位节点包的根路径 =====================
# 获取APPDATA路径
appdata = os.environ.get("APPDATA")
# 定位Dynamo Revit根目录
dynamo_root = os.path.join(appdata, "Dynamo", "Dynamo Revit")
if not os.path.isdir(dynamo_root):
    print(f"Dynamo根目录不存在 - {dynamo_root}")
# 遍历版本目录，查找包路径
lib_path = None
try:
    for version_dir in os.listdir(dynamo_root):
        version_path = os.path.join(dynamo_root, version_dir)
        # 跳过非目录
        if not os.path.isdir(version_path):
            continue
        temp_lib = os.path.join(version_path, "Packages", PACKAGE_NAME)
        # 找到第一个有效路径就停止
        if os.path.exists(temp_lib):
            lib_path = temp_lib
            break
except OSError as e:
    print(f"遍历目录时出错：{str(e)}")

def get_package_lib_path():
    if lib_path not in sys.path:
        sys.path.append(lib_path)
    return lib_path, f"lib路径：{lib_path}" if lib_path else "未找到包的节点包目录"

# 初始化路径
get_package_lib_path()

# 将 ./extra/lib 第三方模块也加入系统路径
module_path = os.path.join(lib_path, "extra", "lib")
if module_path not in sys.path:
        sys.path.append(module_path)


# ===================== 2. 读取与验证输入（提前做，避免依赖加载后报错） =====================
# 先验证输入，再加载依赖，减少异常
api_key = IN[0].strip() if (len(IN) > 0 and IN[0] and isinstance(IN[0], str)) else ""
user_query = IN[1].strip() if (len(IN) > 1 and IN[1] and isinstance(IN[1], str)) else ""

# 输入验证（失败直接返回，不加载依赖）
if not api_key:
    OUT = "IN[0] 需要有效的API Key字符串"
elif not user_query:
    OUT = "IN[1] 需要有效的问题字符串"
else:
    # ===================== 3. 加载路径+导入openai（仅在输入有效时执行） =====================
    # 把元组的第1个元素赋值给lib_path，第2个赋值给path_msg
    lib_path, path_msg = get_package_lib_path()
    print(f"【路径验证】{path_msg}")

    #openai_loaded = False
    # 清理缓存，避免加载旧版本
    #if "openai" in sys.modules.keys():
        #del sys.modules["openai"]
    # 核心：把导入逻辑完全放进try里，启动时不会触发
    try:
        # 从 ./extra/lib 中导入openai库；从 ./librevit_mcp_tools 导入配置
        from openai import OpenAI
        from revit_mcp_tools.config import BASE_URL, MODEL
        from revit_mcp_tools.mcp_handler import clean_think_content
        
        print("openai导入成功")
        openai_loaded = True
    except Exception as e:
        OUT = f"openai导入失败：{type(e).__name__} - {str(e)}"
        print(OUT)

    # ===================== 4. 调用 DeepSeek API（仅在依赖加载成功时执行） =====================
    # ========== 1. 定义本地文件路径（系统文档目录，100%有权限） ==========
    USER_DOCS = os.path.expanduser("~\\Documents\\archai_data")
    os.makedirs(USER_DOCS, exist_ok=True)
    HIS_FILE = os.path.join(USER_DOCS, "ai_chatting_history.json")
    
    MAX_HISTORY = 10  # 最多保留10轮对话，避免token过长
    
    # ========== 2. 读取本地历史对话 ==========
    chat_history = []
    if os.path.exists(HIS_FILE):
        try:
            with open(HIS_FILE, "r", encoding="utf-8") as f:
                chat_history = json.load(f)
        except:
            # 文件损坏时重置为空
            chat_history = []
    
    # ========== 3. 调用DeepSeek API（仅在依赖加载成功时执行） ==========
    if openai_loaded:
        system_message = "You are an assistant"
        try:
            client = OpenAI(api_key=api_key, base_url=BASE_URL)
            
            # 把系统提示、历史对话、当前提问拼接起来
            messages = [{"role": "system", "content": system_message}] + chat_history + [{"role": "user", "content": user_query}]
            
            response = client.chat.completions.create(
                model=MODEL,
                messages=messages,
                stream=False
            )
            raw_result = response.choices[0].message.content
            OUT = clean_think_content(raw_result)
            
            # ========== 4. 更新历史对话并写入本地文件 ==========
            chat_history.append({"role": "user", "content": user_query})
            chat_history.append({"role": "assistant", "content": OUT})
            
            # 裁剪历史，只保留最近10轮
            if len(chat_history) > MAX_HISTORY * 2:
                chat_history = chat_history[-(MAX_HISTORY * 2):]
            
            # 写入文件（必定生成）
            with open(HIS_FILE, "w", encoding="utf-8") as f:
                json.dump(chat_history, f, ensure_ascii=False, indent=2)
                
        except Exception as e:
            OUT = f"API 调用失败: {str(e)}"
            print(OUT)
    elif not openai_loaded and not OUT:
        OUT = "未加载到openai模块，无法调用API"
        print(OUT)
    
    # 最终输出（确保OUT始终有值）
    # print(f"最终结果: {OUT}")
# ----------------------------------------
Markdown = Output(python_script)  # AI-Generated Result 返回 AI 生成的结果
