# Dynamo custom node MarkdownViewer.dyf (Dynamo 2.19.3.6394)
# category: ArchAI.Common
# Supports Markdown-formatted text input for polisher formatted display | 支持 Markdown 格式文本输入，实现内容美化格式化展示

Markdown = Input(Markdown: var[]..[])  # Input Markdown-formatted Text Content 输入 Markdown 格式文本内容
python_script = Python(IN[0]=Markdown)  # CPython3
# ---------- python_script.python (471 lines) ----------
# Dynamo CPython3 | 最终稳定版（逐行表格解析，100%稳定 + 支持引用语法）
import clr
import re

# 加载.NET 必需程序集
clr.AddReference("System.Windows.Forms")
clr.AddReference("System.Drawing")
clr.AddReference("System")

from System.Windows.Forms import Form, WebBrowser, DockStyle, FormBorderStyle, FormStartPosition, Application
from System.Drawing import Size
from System import AppDomain

# --------------------------
# 全局配置
# --------------------------
WINDOW_TITLE = "ArchAI 内容面板"
APP_DOMAIN_KEY = "DEEPSEEK_FINAL_INSTANCE"

# --------------------------
# 核心：查找已存在的目标窗口（单窗口不重复）
# --------------------------
def find_existing_window():
    target_window = None
    try:
        all_open_forms = Application.OpenForms
        for i in range(all_open_forms.Count):
            form = all_open_forms[i]
            if form.Text == WINDOW_TITLE and not form.IsDisposed:
                if target_window is None:
                    target_window = form
                else:
                    form.Close()
                    form.Dispose()
    except:
        try:
            stored_form = AppDomain.CurrentDomain.GetData(APP_DOMAIN_KEY)
            if stored_form is not None and not stored_form.IsDisposed:
                target_window = stored_form
        except:
            target_window = None
    return target_window

# --------------------------
# 【核心重构】逐行状态机解析Markdown表格
# --------------------------
def parse_all_tables(text):
    lines = text.split('\n')
    processed_lines = []
    tables = []
    in_table = False
    current_table_rows = []

    def is_table_line(line):
        stripped = line.strip()
        return '|' in stripped and stripped.count('|') >= 2

    def is_separator_line(line):
        if not is_table_line(line):
            return False
        cells = [cell.strip() for cell in line.strip().strip('|').split('|')]
        for cell in cells:
            if not re.match(r'^:?-+:?$', cell):
                return False
        return True

    def split_table_cells(line):
        return [cell.strip() for cell in line.strip().strip('|').split('|')]

    def table_to_html(table_rows):
        if len(table_rows) < 2:
            return '\n'.join(table_rows)
        header_cells = split_table_cells(table_rows[0])
        separator_cells = split_table_cells(table_rows[1])
        col_count = len(separator_cells)
        data_rows = table_rows[2:]

        def pad_cells(cells, target):
            padded = cells[:target]
            while len(padded) < target:
                padded.append('')
            return padded

        header_padded = pad_cells(header_cells, col_count)
        data_padded = [pad_cells(split_table_cells(row), col_count) for row in data_rows]

        header_html = '<tr>' + ''.join([f'<th>{cell}</th>' for cell in header_padded]) + '</tr>'
        body_html = ''
        for row in data_padded:
            body_html += '<tr>' + ''.join([f'<td>{cell}</td>' for cell in row]) + '</tr>'

        full_table = f"""
        <table>
            <thead>{header_html}</thead>
            <tbody>{body_html}</tbody>
        </table>
        """
        return full_table

    i = 0
    total_lines = len(lines)
    while i < total_lines:
        current_line = lines[i]
        if not in_table:
            if i + 1 < total_lines and is_table_line(current_line) and is_separator_line(lines[i+1]):
                in_table = True
                current_table_rows = [current_line, lines[i+1]]
                i += 2
            else:
                processed_lines.append(current_line)
                i += 1
        else:
            if is_table_line(current_line):
                current_table_rows.append(current_line)
                i += 1
            else:
                table_html = table_to_html(current_table_rows)
                tables.append(table_html)
                processed_lines.append(f"@@@TABLE_{len(tables)-1}@@@")
                in_table = False
                current_table_rows = []
    if in_table and len(current_table_rows) >= 2:
        table_html = table_to_html(current_table_rows)
        tables.append(table_html)
        processed_lines.append(f"@@@TABLE_{len(tables)-1}@@@")
    return '\n'.join(processed_lines), tables

# --------------------------
# 新增：解析 Markdown 引用语法 > （核心升级）
# --------------------------
def parse_blockquotes(text):
    lines = text.split('\n')
    new_lines = []
    in_quote = False
    quote_content = []
    
    for line in lines:
        stripped = line.strip()
        # 识别以 > 开头的引用行
        if stripped.startswith('>'):
            in_quote = True
            # 去掉 > 和空格，提取纯文本
            content = stripped.lstrip('>').strip()
            quote_content.append(content)
        else:
            # 退出引用，拼接HTML
            if in_quote:
                in_quote = False
                quote_html = f"<blockquote>{'<br>'.join(quote_content)}</blockquote>"
                new_lines.append(quote_html)
                quote_content = []
            new_lines.append(line)
    # 处理末尾的引用
    if in_quote:
        quote_html = f"<blockquote>{'<br>'.join(quote_content)}</blockquote>"
        new_lines.append(quote_html)
    return '\n'.join(new_lines)

# --------------------------
# 全功能Markdown转HTML
# --------------------------
def markdown_to_html_stable(md_text):
    if not md_text:
        return "<p>无内容</p>"

    md_text = md_text.replace('\r\n', '\n').replace('\r', '\n')

    # 1. 代码块
    code_blocks = []
    def save_code_block(match):
        code_blocks.append(match.group(0))
        return f"@@@CODE_BLOCK_{len(code_blocks)-1}@@@"
    code_pattern = re.compile(r'```[\s\S]*?```', re.MULTILINE)
    processed_text = code_pattern.sub(save_code_block, md_text)

    # 2. 表格
    processed_text, tables = parse_all_tables(processed_text)

    # 3. 分割线
    hr_regex = re.compile(r'^\s*([-*])\1{2,}\s*$', re.MULTILINE)
    processed_text = hr_regex.sub('<hr>', processed_text)

    # 4. 标题
    for level in range(6, 0, -1):
        prefix = '#' * level
        lines = processed_text.split('\n')
        new_lines = []
        for line in lines:
            stripped = line.strip()
            if stripped.startswith(f'{prefix} ') and not line.startswith('@@@'):
                new_lines.append(f'<h{level}>{stripped[len(prefix)+1:]}</h{level}>')
            else:
                new_lines.append(line)
        processed_text = '\n'.join(new_lines)
    
    # 🔥 5. 新增：解析引用语法 >
    processed_text = parse_blockquotes(processed_text)

    # 6. 无序列表
    lines = processed_text.split('\n')
    in_ul = False
    new_lines = []
    for line in lines:
        stripped = line.strip()
        if stripped.startswith(('* ', '- ')) and not stripped.startswith('@@@') and '|' not in stripped:
            if not in_ul:
                new_lines.append('<ul>')
                in_ul = True
            new_lines.append(f'<li>{stripped[2:]}</li>')
        else:
            if in_ul:
                new_lines.append('</ul>')
                in_ul = False
            new_lines.append(line)
    if in_ul:
        new_lines.append('</ul>')
    processed_text = '\n'.join(new_lines)
    
    # 7. 有序列表
    lines = processed_text.split('\n')
    in_ol = False
    new_lines = []
    for line in lines:
        stripped = line.strip()
        if re.match(r'^\d+\.\s', stripped) and not stripped.startswith('@@@') and '|' not in stripped:
            if not in_ol:
                new_lines.append('<ol>')
                in_ol = True
            content = re.sub(r'^\d+\.\s', '', stripped)
            new_lines.append(f'<li>{content}</li>')
        else:
            if in_ol:
                new_lines.append('</ol>')
                in_ol = False
            new_lines.append(line)
    if in_ol:
        new_lines.append('</ol>')
    processed_text = '\n'.join(new_lines)

    # 8. 行内格式（加粗/斜体）
    while '**' in processed_text:
        processed_text = processed_text.replace('**', '<strong>', 1)
        processed_text = processed_text.replace('**', '</strong>', 1)
    
    def italic_replace(match):
        content = match.group(1)
        return f'<em>{content}</em>'
    italic_regex = re.compile(r'\*([^*]+?)\*')
    processed_text = italic_regex.sub(italic_replace, processed_text)

    # 9. 段落处理
    lines = processed_text.split('\n')
    new_lines = []
    for line in lines:
        stripped = line.strip()
        if not stripped:
            continue
        # 跳过HTML标签、占位符，不重复包裹
        if stripped.startswith(('<', '@@@', '<blockquote>', '</blockquote>')):
            new_lines.append(stripped)
        else:
            new_lines.append(f'<p>{stripped}</p>')
    processed_text = '\n'.join(new_lines)

    # 还原内容
    for i, table in enumerate(tables):
        processed_text = processed_text.replace(f'@@@TABLE_{i}@@@', table)
    for i, code_block in enumerate(code_blocks):
        lines = code_block.split('\n')
        lang = lines[0].replace('```', '').strip()
        code_content = '\n'.join(lines[1:-1])
        code_escaped = code_content.replace('&', '&amp;').replace('<', '&lt;').replace('>', '&gt;')
        code_html = f'<pre><code class="{lang}">{code_escaped}</code></pre>'
        processed_text = processed_text.replace(f'@@@CODE_BLOCK_{i}@@@', code_html)

    return processed_text

# --------------------------
# 创建/刷新窗口
# --------------------------
def show_or_refresh_window(md_content):
    html_body = markdown_to_html_stable(md_content)
    
    full_html = f"""
    <!DOCTYPE html>
    <html lang="zh-CN">
    <head>
        <meta charset="UTF-8">
        <meta http-equiv="X-UA-Compatible" content="IE=11">
        <meta name="viewport" content="width=device-width, initial-scale=1.0">
        <title>DeepSeek Content</title>
        <style>
            * {{
                margin: 0;
                padding: 0;
                box-sizing: border-box;
                -webkit-font-smoothing: antialiased;
                text-rendering: optimizeLegibility;
            }}
            body {{
                font-family: "Microsoft YaHei UI", "Microsoft YaHei", "Segoe UI", system-ui, sans-serif;
                font-size: 15px;
                font-weight: 400;
                line-height: 1.75;
                letter-spacing: 0.2px;
                color: #2c3e50;
                background-color: #ffffff;
                padding: 40px 32px;
                max-width: 1000px;
                margin: 0 auto;
                word-wrap: break-word;
                white-space: normal;
            }}
            h1, h2, h3, h4, h5, h6 {{
                color: #1a2530;
                font-weight: 600;
                line-height: 1.3;
                margin: 32px 0 16px 0;
            }}
            h1 {{
                font-size: 26px;
                font-weight: 700;
                padding-bottom: 12px;
                border-bottom: 1px solid #eaecef;
            }}
            h2 {{
                font-size: 22px;
                padding-bottom: 8px;
            }}
            h3 {{
                font-size: 19px;
            }}
            p {{
                margin-bottom: 16px;
            }}
            ul, ol {{
                margin: 0 0 16px 32px;
            }}
            li {{
                margin-bottom: 8px;
            }}
            hr {{
                border: none;
                height: 1px;
                background-color: #e5e7eb;
                margin: 32px 0;
            }}
            pre {{
                background-color: #f8fafc;
                border-radius: 8px;
                padding: 20px 24px;
                margin: 0 0 20px 0;
                overflow-x: auto;
                line-height: 1.6;
                border: 1px solid #f1f5f9;
            }}
            code {{
                font-family: "Cascadia Code", "Consolas", "Courier New", monospace;
                font-size: 14px;
            }}
            p code, li code {{
                background-color: #f1f5f9;
                color: #e11d48;
                padding: 3px 7px;
                border-radius: 4px;
                font-size: 13px;
            }}
            table {{
                border-collapse: collapse;
                width: 100%;
                margin: 20px 0;
                overflow-x: auto;
                display: block;
                border-radius: 8px;
                border: 1px solid #d1d5db;
                font-size: 14px;
            }}
            table th, table td {{
                padding: 12px 16px;
                text-align: left;
                border-bottom: 1px solid #d1d5db;
                border-right: 1px solid #d1d5db;
                word-break: keep-all;
                white-space: nowrap;
            }}
            table th:last-child, table td:last-child {{
                border-right: none;
            }}
            table tr:last-child td {{
                border-bottom: none;
            }}
            table th {{
                background-color: #f3f4f6;
                font-weight: 600;
                color: #111827;
            }}
            table tr:nth-child(even) {{
                background-color: #f9fafb;
            }}
            /* 引用块样式（已内置，完美生效） */
            blockquote {{
                border-left: 4px solid #165dff;
                background-color: #f0f7ff;
                padding: 14px 20px;
                margin: 0 0 20px 0;
                color: #475569;
                border-radius: 0 6px 6px 0;
            }}
            blockquote p {{
                margin: 0;
            }}
            a {{
                color: #165dff;
                text-decoration: none;
                font-weight: 500;
            }}
            strong {{
                font-weight: 600;
                color: #1a2530;
            }}
            em {{
                font-style: italic;
                color: #475569;
            }}
        </style>
    </head>
    <body>
        {html_body}
    </body>
    </html>
    """

    existing_window = find_existing_window()
    if existing_window is not None:
        try:
            web_browser = existing_window.Controls[0]
            web_browser.DocumentText = full_html
            existing_window.Activate()
            existing_window.BringToFront()
            return "✅ 成功：支持引用语法，内容已刷新"
        except Exception as e:
            try:
                existing_window.Close()
                existing_window.Dispose()
            except:
                pass

    new_form = Form()
    new_form.Text = WINDOW_TITLE
    new_form.Size = Size(1000, 1000)
    new_form.StartPosition = FormStartPosition.CenterScreen
    new_form.FormBorderStyle = FormBorderStyle.Sizable
    web_browser = WebBrowser()
    web_browser.Dock = DockStyle.Fill
    web_browser.ScrollBarsEnabled = True
    web_browser.ScriptErrorsSuppressed = True
    web_browser.DocumentText = full_html
    new_form.Controls.Add(web_browser)
    new_form.Show()

    try:
        AppDomain.CurrentDomain.SetData(APP_DOMAIN_KEY, new_form)
    except:
        pass
    return "✅ 成功：支持引用语法，窗口已创建"

# --------------------------
# 主执行逻辑
# --------------------------
md_input = IN[0] if len(IN) > 0 and IN[0] is not None else "无输入内容"
OUT = show_or_refresh_window(md_input)
# ----------------------------------------
Void = Output(python_script)
