# Dynamo custom node McpToolWhitelist.dyf "MCPToolWhitelist" (Dynamo 2.19.3.6394)
# category: ArchAI.Common
# Returns whitelisted  MCP tools invoked by AI | 返回 AI 调用的MCP 白名单工具

python_script = Python()  # CPython3
# ---------- python_script.python (123 lines) ----------
import sys
import os

# 必须和Packages下的包文件夹名完全一致（大小写敏感）
PACKAGE_NAME = "ArchAI"
OUT = ""  # 初始化OUT，避免未定义

# ===================== 1. 自动定位节点包的根路径 =====================
# 获取APPDATA路径
appdata = os.environ.get("APPDATA")
# 定位Dynamo Revit根目录
dynamo_root = os.path.join(appdata, "Dynamo", "Dynamo Revit")
if not os.path.isdir(dynamo_root):
    print(f"Dynamo根目录不存在 - {dynamo_root}")
# 遍历版本目录，查找包路径
lib_path = None
try:
    for version_dir in os.listdir(dynamo_root):
        version_path = os.path.join(dynamo_root, version_dir)
        # 跳过非目录
        if not os.path.isdir(version_path):
            continue
        temp_lib = os.path.join(version_path, "Packages", PACKAGE_NAME)
        # 找到第一个有效路径就停止
        if os.path.exists(temp_lib):
            lib_path = temp_lib
            break
except OSError as e:
    print(f"遍历目录时出错：{str(e)}")

def get_package_lib_path():
    if lib_path not in sys.path:
        sys.path.append(lib_path)
    return lib_path, f"lib路径：{lib_path}" if lib_path else "未找到包的节点包目录"

# 初始化路径
get_package_lib_path()

# ================================2. 获取工具白名===========================
# MCP通用建筑建模主入口 - 生成100%宽度无空白的MD表格工具列表
from revit_mcp_tools.config import MCP_TOOL_WHITELIST

# 统计工具总数
total_tool_count = len(MCP_TOOL_WHITELIST)

def format_params(param_dict):
    """格式化参数字典为表格友好的字符串"""
    if not param_dict:
        return "无"
    return "<br>".join([f"{k}：{v}" for k, v in param_dict.items()])

# 初始化MD文本
md_content = f"""# MCP建筑建模工具白名单
作者：非天生建筑师

> 本工具白名单为MCP通用建筑建模核心功能集
> 仅支持标准Revit原生构件操作，无额外插件依赖、无冗余流程
> 支持AI**多轮连续问询**，自带**上下文记忆缓存**
> 可自动继承上一轮执行结果，分步拆解复杂建模任务
> 共计：**{total_tool_count} 个**专业建模工具
"""

# ==================================================
# 【✅ 100% 精准匹配你白名单的最终索引】
# ==================================================
modules = [
    ("第一模块：选择查询工具",            0,  4),   # 0-3   共4个 ✔️
    ("第二模块：建筑方案设计工具",        4,  6),   # 4-5   共2个 ✔️
    ("第三模块：常用构件创建工具",        6, 12),   # 6-11  共6个 ✔️
    ("第四模块：常用构件修改工具",       12, 19),   # 12-18 共7个 ✔️
    ("第五模块：消防疏散路径工具",       19, 21),   # 19-20 共2个 ✔️
    ("第六模块：房间优化工具",           21, 23),   # 21-22 共2个 ✔️
    ("第七模块：构件标记工具",           23, 27),   # 23-26 共4个 ✔️
    ("第八模块：轴网管理工具",           27, 32),   # 27-31 共5个 ✔️
    ("第九模块：视图管理工具",           32, 36),   # 32-35 共4个 ✔️
    ("第十模块：模型检查工具",           36, 40),   # 36-39 共4个 ✔️
]

# 遍历每个模块生成100%宽度无空白表格
for module_name, start_idx, end_idx in modules:
    # 模块标题
    md_content += f"## {module_name}\n\n"
    # HTML表格：100%宽度，精准分配列宽，彻底解决右侧空白
    md_content += """
<table width="100%">
  <thead>
    <tr>
      <th width="5%" align="center">序号</th>
      <th width="15%" align="left">工具名称</th>
      <th width="30%" align="left">功能描述</th>
      <th width="35%" align="left">必填参数</th>
      <th width="15%" align="left">可选参数</th>
    </tr>
  </thead>
  <tbody>
"""
    # 遍历模块内工具生成表格行
    for idx, tool in enumerate(MCP_TOOL_WHITELIST[start_idx:end_idx], 1):
        tool_name = tool["tool_name"]
        desc = tool["description"]
        req = format_params(tool["required_params"])
        opt = format_params(tool["optional_params"])
        # 表格行
        md_content += f"""
    <tr>
      <td align="center">{idx}</td>
      <td align="left">{tool_name}</td>
      <td align="left">{desc}</td>
      <td align="left">{req}</td>
      <td align="left">{opt}</td>
    </tr>
"""
    # 表格闭合+模块分割线
    md_content += """
  </tbody>
</table>

<hr>

"""

# 最终输出（去除首尾多余空白）
OUT = md_content.strip()
# ----------------------------------------
Markdown = Output(python_script)  # List of MCP Tool Whitelist 返回 MCP 工具白名单
