# Dynamo custom node RandomGeneration.dyf (Dynamo 2.19.3.6394)
# category: ArchAI.Modeling
# AI-driven random generation with uncertain outputs | AI 随机生成，输出具备不确定性

api_key = Input(api_key: string)  # API Keys, Default to DeepSeek API 密钥，默认为 DeepSeek 模型
user_query = Input(user_query: string)  # Query Prompt 查询指令
python_script = Python(IN[0]=api_key, IN[1]=user_query)  # CPython3
# ---------- python_script.python (188 lines) ----------
import sys
import os
import json

# 必须和Packages下的包文件夹名完全一致（大小写敏感）
PACKAGE_NAME = "ArchAI"
OUT = ""  # 初始化OUT，避免未定义

# ===================== 1. 自动定位节点包的根路径 =====================
# 获取APPDATA路径
appdata = os.environ.get("APPDATA")
# 定位Dynamo Revit根目录
dynamo_root = os.path.join(appdata, "Dynamo", "Dynamo Revit")
if not os.path.isdir(dynamo_root):
    print(f"Dynamo根目录不存在 - {dynamo_root}")
# 遍历版本目录，查找包路径
lib_path = None
try:
    for version_dir in os.listdir(dynamo_root):
        version_path = os.path.join(dynamo_root, version_dir)
        # 跳过非目录
        if not os.path.isdir(version_path):
            continue
        temp_lib = os.path.join(version_path, "Packages", PACKAGE_NAME)
        # 找到第一个有效路径就停止
        if os.path.exists(temp_lib):
            lib_path = temp_lib
            break
except OSError as e:
    print(f"遍历目录时出错：{str(e)}")

def get_package_lib_path():
    if lib_path not in sys.path:
        sys.path.append(lib_path)
    return lib_path, f"lib路径：{lib_path}" if lib_path else "未找到包的节点包目录"

# 初始化路径
get_package_lib_path()

# 将 ./extra/lib 第三方模块也加入系统路径
module_path = os.path.join(lib_path, "extra", "lib")
if module_path not in sys.path:
        sys.path.append(module_path)


# ===================== 2. 读取与验证输入（提前做，避免依赖加载后报错） =====================
# 先验证输入，再加载依赖，减少异常
api_key = IN[0].strip() if (len(IN) > 0 and IN[0] and isinstance(IN[0], str)) else ""
user_query = IN[1].strip() if (len(IN) > 1 and IN[1] and isinstance(IN[1], str)) else ""

# 输入验证（失败直接返回，不加载依赖）
if not api_key:
    OUT = "IN[0] 需要有效的API Key字符串"
elif not user_query:
    OUT = "IN[1] 需要有效的问题字符串"
else:
    # ===================== 3. 加载路径+导入openai（仅在输入有效时执行） =====================
    # 把元组的第1个元素赋值给lib_path，第2个赋值给path_msg
    lib_path, path_msg = get_package_lib_path()
    print(f"【路径验证】{path_msg}")

    openai_loaded = False
    # 清理缓存，避免加载旧版本
    if "openai" in sys.modules.keys():
        del sys.modules["openai"]
    # 核心：把导入逻辑完全放进try里，启动时不会触发
    try:
        # 从 ./extra/lib 中导入openai库；从 ./librevit_mcp_tools 导入配置
        from openai import OpenAI
        from revit_mcp_tools.config import BASE_URL, MODEL
        from revit_mcp_tools.mcp_handler import clean_think_content
        
        print("openai导入成功")
        openai_loaded = True
    except Exception as e:
        OUT = f"openai导入失败：{type(e).__name__} - {str(e)}"
        print(OUT)

    # ===================== 4. 调用 DeepSeek API（仅在依赖加载成功时执行） =====================
    # ========== 1. 定义本地文件路径（系统文档目录，100%有权限） ==========
    USER_DOCS = os.path.expanduser("~\\Documents\\archai_data")
    os.makedirs(USER_DOCS, exist_ok=True)
    HIS_FILE = os.path.join(USER_DOCS, "ai_modeling_history.json")
    MAX_HISTORY = 10  # 最多保留10轮对话，避免token过长
    
    # ========== 2. 读取本地历史对话 ==========
    chat_history = []
    if os.path.exists(HIS_FILE):
        try:
            with open(HIS_FILE, "r", encoding="utf-8") as f:
                chat_history = json.load(f)
        except:
            # 文件损坏时重置为空
            chat_history = []
    
    # ========== 3. 调用DeepSeek API（仅在依赖加载成功时执行） ==========
    if openai_loaded:
        system_message = f"""
你是专业的Revit Dynamo PythonScript（Cpython）代码生成助手，仅输出可运行的纯代码，不包含任何解释、说明文字或额外文本。绝对遵循以下内容：
=====【强制核心指令 必严格执行】=====
1. 务必通读全部历史对话记录，牢牢记住用户**最初原始业务需求**，全程不可遗忘、不可偏离
2. 区分用户输入类型：
   - 用户发送全新需求：正常按规则生成对应完整代码
   - 用户发送**代码运行报错、异常日志、错误信息**：禁止重新编写新需求，必须结合历史原始需求 + 报错内容排查问题，精准修正代码BUG
3. 修复报错代码时，保留原有业务逻辑，严格沿用固定导入、事务写法、单位转换规则，只修改报错出错部分
4. 无论全新生成还是报错修复，最终只输出完整可直接运行的Python代码，无任何多余文字
=====【固定规则 全部遵守】=====
【规则1】：禁止使用Pyrevit代码、ironpython、Revit MCP代码，严格使用原生Revit API，版本为Revit 2024。
【规则2】：所有尺寸参数必须通过Revit API的UnitUtils.ConvertToInternalUnits方法将米（m）、毫米(mm)、厘米(cm)转换为英尺。
【规则3】：为避免错误，必须使用以下的固定导入内容（自行去掉退格缩进），禁止自行导入其他内容：
        import sys
        import os
        import math
        import json
        import clr
        
        import clr
        clr.AddReference('ProtoGeometry')
        from Autodesk.DesignScript.Geometry import *
        clr.AddReference('DSCoreNodes')
        import DSCore  # 为避免冲突，使用DSCore.List.XX
        clr.AddReference('RevitNodes')
        import Revit   # 为避免冲突，使用Revit.Elements.XX
        clr.ImportExtensions(Revit.Elements)
        clr.ImportExtensions(Revit.GeometryConversion)
        
        clr.AddReference('RevitAPI')
        clr.AddReference('RevitAPIUI')
        clr.AddReference("System.Collections")
        import System
        from Autodesk.Revit.DB import *
        from Autodesk.Revit.UI import *
        from System.Collections.Generic import *
        
        clr.AddReference("RevitServices")
        import RevitServices
        from RevitServices.Persistence import DocumentManager
        from RevitServices.Transactions import TransactionManager
        
        doc = DocumentManager.Instance.CurrentDBDocument
        app = doc.Application
        uiApp = DocumentManager.Instance.CurrentUIApplication
        uidoc = uiApp.ActiveUIDocument

【规则4】：为避免错误，必须使用以下固定格式（自行去掉退格缩进），禁止自行修改：
        固定导入内容
        TransactionManager.Instance.EnsureInTransaction(doc)
        你的代码
        TransactionManager.Instance.TransactionTaskDone()
【规则5】：参数不全时，使用OUT输出，直接向用户索要必填参数，不说多余的话。
【规则6】：非Revit代码生成需求，直接拒绝。
"""
        try:
            client = OpenAI(api_key=api_key, base_url=BASE_URL)
            
            # 把系统提示、历史对话、当前提问拼接起来
            messages = [{"role": "system", "content": system_message}] + chat_history + [{"role": "user", "content": user_query}]
            
            response = client.chat.completions.create(
                model=MODEL,
                messages=messages,
                stream=False
            )
            raw_result = response.choices[0].message.content
            OUT = clean_think_content(raw_result)
            
            # ========== 4. 更新历史对话并写入本地文件 ==========
            chat_history.append({"role": "user", "content": user_query})
            chat_history.append({"role": "assistant", "content": OUT})
            
            # 裁剪历史，只保留最近10轮
            if len(chat_history) > MAX_HISTORY * 2:
                chat_history = chat_history[-(MAX_HISTORY * 2):]
            
            # 写入文件（必定生成）
            with open(HIS_FILE, "w", encoding="utf-8") as f:
                json.dump(chat_history, f, ensure_ascii=False, indent=2)
                
        except Exception as e:
            OUT = f"API 调用失败: {str(e)}"
            print(OUT)
    elif not openai_loaded and not OUT:
        OUT = "未加载到openai模块，无法调用API"
        print(OUT)
    
    # 最终输出（确保OUT始终有值）
    # print(f"最终结果: {OUT}")
    
# ----------------------------------------
python_script_2 = Python(IN[0]=python_script)  # CPython3
# ---------- python_script_2.python (36 lines) ----------
import re

def clean_script_string(raw):
    # 去除首尾空白以便检查标记（但不影响最终输出）
    stripped = raw.strip()
    
    # 检查是否包含开头标记（[ 或 ```python）或结尾标记（] 或 ```）
    has_prefix = stripped.startswith('[') or stripped.startswith('```python')
    has_suffix = stripped.endswith(']') or stripped.endswith('```')
    
    if has_prefix or has_suffix:
        # 第一部分：匹配开头的存在包裹标记
        # ^:匹配字符串的开头
        # \s*:匹配开头的任意数量空白字符（包括换行）
        # (\[\s*)?:可选地匹配 [ 及其后面的空白字符
        # ```python：匹配markdown代码块的开头标记
        # \s*：匹配代码标记块的任意数量空白字符
        # |：或者
        # 第二部分：匹配结尾的包裹标记
        # \s*:匹配代码块结束标志前的任意数量空白字符
        # ```：匹配markdown代码块的结束标记
        # \s*：匹配代码标记块结束后的任意数量空白字符
        # (\[\s*)?：可选地匹配 ] 及其后面的空白字符
        # $：匹配字符串的结尾
        pattern = r'^\s*(\[\s*)?```python\s*|\s*```\s*(\]\s*)?$'
        cleaned = re.sub(pattern, '', raw, flags=re.DOTALL)
        return cleaned.strip()   # 清理后去除首尾空白，得到纯净代码
    else:
        # 没有检测到包裹标记，直接返回原始字符串（保留原格式，包括首尾空白）
        return raw

raw_str = IN[0]
if raw_str is None or not isinstance(raw_str, str):
    OUT = ""   # 输入无效时返回空字符串
else:
    OUT = clean_script_string(raw_str)
# ----------------------------------------
执行代码 = Python(IN[0]=python_script_2)  # CPython3
# ---------- 执行代码.python (12 lines) ----------
import traceback

try:
    # 执行传入的Python代码字符串
    namespace = {}
    exec(IN[0], namespace)
    # 执行成功：直接返回代码中的 OUT 结果
    OUT = namespace.get("OUT", "执行成功（无返回值）")

except Exception:
    # 执行失败：直接返回完整报错文本（纯字符串，无包装）
    OUT = "❌ 代码执行报错：\n" + traceback.format_exc()
# ----------------------------------------
Result = Output(执行代码)  # AI-Generated Result 返回 AI 生成的结果
Script = Output(python_script_2)  # AI-Generated Script 返回 AI 生成的代码
