# Dynamo custom node SpecList.dyf (Dynamo 2.19.3.6394)
# category: ArchAI.Specs
# List of Local Specification Library Names | 返回本地规范库名称列表

python_script = Python()  # CPython3
# ---------- python_script.python (49 lines) ----------
import sys
import os

# 必须和Packages下的包文件夹名完全一致（大小写敏感）
PACKAGE_NAME = "ArchAI"
OUT = ""  # 初始化OUT，避免未定义

# ===================== 1. 自动定位节点包的根路径 =====================
# 获取APPDATA路径
appdata = os.environ.get("APPDATA")
# 定位Dynamo Revit根目录
dynamo_root = os.path.join(appdata, "Dynamo", "Dynamo Revit")
if not os.path.isdir(dynamo_root):
    print(f"Dynamo根目录不存在 - {dynamo_root}")
# 遍历版本目录，查找包路径
lib_path = None
try:
    for version_dir in os.listdir(dynamo_root):
        version_path = os.path.join(dynamo_root, version_dir)
        # 跳过非目录
        if not os.path.isdir(version_path):
            continue
        temp_lib = os.path.join(version_path, "Packages", PACKAGE_NAME)
        # 找到第一个有效路径就停止
        if os.path.exists(temp_lib):
            lib_path = temp_lib
            break
except OSError as e:
    print(f"遍历目录时出错：{str(e)}")

def get_package_lib_path():
    if lib_path not in sys.path:
        sys.path.append(lib_path)
    return lib_path, f"lib路径：{lib_path}" if lib_path else "未找到包的节点包目录"

# 初始化路径
get_package_lib_path()

# 将 ./extra/lib 第三方模块也加入系统路径
module_path = os.path.join(lib_path, "extra", "lib")
if module_path not in sys.path:
        sys.path.append(module_path)


# ================================2. 获取本地规范库===========================
from specification.tools.spec_loader import get_all_spec_files

spec_list = get_all_spec_files()
OUT = spec_list
# ----------------------------------------
SpecNameList = Output(python_script)  # List of Local Specification Library Names 返回本地规范库名称列表
