# Dynamo custom node SpecQuery.dyf (Dynamo 2.19.3.6394)
# category: ArchAI.Specs
# Leverage local custom spec library to constrain AI for precise, specification-compliant outputs | 依托本地自定义规范知识库，约束 AI 输出精准合规的专业结果

api_key = Input(api_key: string)  # API Keys, Default to DeepSeek API 密钥，默认为 DeepSeek 模型
user_query = Input(user_query: string)  # Specification Query Prompt 规范查询指令
spec_name = Input(spec_name: string)  # Specify Local Specification 指定调用的本地规范名称
python_script = Python(IN[0]=api_key, IN[1]=user_query, IN[2]=spec_name)  # CPython3
# ---------- python_script.python (79 lines) ----------
import sys
import os

# 必须和Packages下的包文件夹名完全一致（大小写敏感）
PACKAGE_NAME = "ArchAI"
OUT = ""  # 初始化OUT，避免未定义

# ===================== 1. 自动定位节点包的根路径 =====================
# 获取APPDATA路径
appdata = os.environ.get("APPDATA")
# 定位Dynamo Revit根目录
dynamo_root = os.path.join(appdata, "Dynamo", "Dynamo Revit")
if not os.path.isdir(dynamo_root):
    print(f"Dynamo根目录不存在 - {dynamo_root}")
# 遍历版本目录，查找包路径
lib_path = None
try:
    for version_dir in os.listdir(dynamo_root):
        version_path = os.path.join(dynamo_root, version_dir)
        # 跳过非目录
        if not os.path.isdir(version_path):
            continue
        temp_lib = os.path.join(version_path, "Packages", PACKAGE_NAME)
        # 找到第一个有效路径就停止
        if os.path.exists(temp_lib):
            lib_path = temp_lib
            break
except OSError as e:
    print(f"遍历目录时出错：{str(e)}")

def get_package_lib_path():
    if lib_path not in sys.path:
        sys.path.append(lib_path)
    return lib_path, f"lib路径：{lib_path}" if lib_path else "未找到包的节点包目录"

# 初始化路径
get_package_lib_path()

# 将 ./extra/lib 第三方模块也加入系统路径
module_path = os.path.join(lib_path, "extra", "lib")
if module_path not in sys.path:
        sys.path.append(module_path)

# ============================== 2. 调用deepseek 主程序 ==============================
api_key = IN[0].strip() if (len(IN) > 0 and IN[0] and isinstance(IN[0], str)) else ""
user_query = IN[1].strip() if (len(IN) > 1 and IN[1] and isinstance(IN[1], str)) else ""
spec_name = IN[2].strip() if (len(IN) > 2 and IN[2] and isinstance(IN[2], str)) else ""

if not api_key:
    OUT = "IN[0] 需要有效的API Key字符串"
elif not user_query:
    OUT = "IN[1] 需要有效的问题字符串"
elif not spec_name:
    OUT = "IN[2] 需要有效的规范名称"


# 使用tools中模块
from openai import OpenAI
from specification.tools.spec_loader import spec_query_question, spec_query_system
from revit_mcp_tools.config import BASE_URL, MODEL
from revit_mcp_tools.mcp_handler import clean_think_content

spec_user_query = spec_query_question(user_query, spec_name)
system_message = spec_query_system(spec_name)
try:
    client = OpenAI(api_key=api_key, base_url= BASE_URL)
    response = client.chat.completions.create(
        model= MODEL,
        messages=[{"role":"system","content":system_message},{"role":"user","content":spec_user_query}],
        stream=False
    )
    raw_result = response.choices[0].message.content
    OUT = clean_think_content(raw_result)
except Exception as e:
    OUT = f"API 调用失败：{str(e)}"
    print(OUT)

# 最终输出（确保OUT始终有值）
print(f"最终结果：{OUT}")
# ----------------------------------------
Markdown = Output(python_script)  # AI-Generated Result 返回 AI 生成的结果
